# Grasshopper definition consumptionForecastExample.gh (Grasshopper 1.0.7)
# plug-ins: HAL for Grasshopper

sessionsettings = SessionSettings()

my_very_own_rte_api_credentials = Panel("MTkyOTVjN2QtNjMyMS00OTE3LTlhZTMtMWFlZmQ2NmQ5NGM5OjBkZTdhNTgyLTc4N2YtNGNmZi05YjM1LTA1MGY2NTVjOTVjYw==")

# ---- group: start date for forecast search
date = ConstructDate(Year="2022", Month="10", Day="29", Hour="0", Minute="0", Second="0")

# ---- group: end date for forecast search.
date_2 = ConstructDate(Year="2022", Month="10", Day="31", Hour="0", Minute="0", Second="0")

# ---- group: Forecast type
list = ValueList({"REALISED", "D-1", "D-2", "ID"}, selected="D-1")

# ---- group: Ask the RTE API for a consumption forecast with the provided arguments.
c_script = CSharpScript(
    credentials=my_very_own_rte_api_credentials,
    forecastType=list,
    startDate=date,
    endDate=date_2,
    Reference="C:\Users\Leo\source\repos\DemoGhLibrary\bin\Debug\net48\RTEApi - Copie.dll")  # -> out, forecastData, consumptionForecast; inputs credentials: String, forecastType: String
# ---------- c_script: C# usings ----------
using RTEApi;
# ---------- c_script: C# ----------
    var forecast = RTEApi.ForecastApplication.GetConsumptionForecast(credentials, forecastType, startDate, endDate);
    //A = forecast;
    forecastData = forecast.ShortTerm[0].Values;
    consumptionForecast = forecast;
# ---------- end c_script ----------

# ----
preview_as_a_string_object_of_the_receiv = Panel(c_script.forecastData)  # "Preview (as a string object) of the received forecast."

# ---- group: Extract the consumptionForecast.forecastData object properties and store them in lists
c_script_2 = CSharpScript(
    consumptionForecast=c_script.consumptionForecast,
    Reference="C:\Users\Leo\source\repos\DemoGhLibrary\bin\Debug\net48\RTEApi - Copie.dll")  # -> out, forecastValues, forecastStartDates, forecastEndDates
# ---------- c_script_2: C# ----------
    // The intent of this script is to extract the consumptionForecast forecastData object's properties and store them in separate lists, following the
    // classic Grasshopper list logic using simple types and not custom classes. This is the default way to handle the data with other plugins.

    // Initialize the lists we'll use to store the object data.
    List<int> forecastValueList = new List<int>();
    List<DateTime> forecastStartDateList = new List<DateTime>();
    List<DateTime> forecastEndDateList = new List<DateTime>();

    // Cast the imput object as a RTEApi.ConsumptionForecast type.
    var forecast = (ConsumptionForecast) consumptionForecast;
    var forecastDataList = forecast.ShortTerm[0].Values;
    // Fill output lists with each forecastData object properties.
    foreach (ForecastData forecastData in forecastDataList){
      forecastStartDateList.Add(forecastData.StartDate);
      forecastEndDateList.Add(forecastData.EndDate);
      forecastValueList.Add(forecastData.Value);
    }

    // Workaround to set the GH output variables from the lists we've declared inside the script.
    forecastValues = forecastValueList;
    forecastStartDates = forecastStartDateList;
    forecastEndDates = forecastEndDateList;
# ---------- end c_script_2 ----------

# ----
panel = Panel(c_script_2.forecastEndDates)
panel_2 = Panel(c_script_2.forecastValues)
panel_3 = Panel(c_script_2.forecastStartDates)
